# Grasshopper definition 1.gh (Grasshopper 1.0.7)

number_slider = Slider(9, range=0..10)
number_slider_2 = Slider(100, range=0..100)
vec = Vector()

# ---- group: STEP 1 Initial Concrete Shape
number_slider_3 = Slider(73, range=0..100)
number_slider_4 = Slider(100, range=0..100)
number_slider_5 = Slider(100, range=0..100)
box = DomainBox(Base=PlaneXY(0, 0, 0), X=number_slider_4, Y=number_slider_5, Z=Slider(35, range=0..100))
vec_2 = VectorXYZ(XComponent=Slider(0, range=0..100), YComponent=number_slider_3, ZComponent=number_slider_3)  # -> Vector, Length
python = GhPythonScript(x=number_slider_4, y=number_slider_5)  # -> out, a
# ---------- python: Python ----------
#Input variabes for concrete block

#dimensions list v = [100,100,100]
#components in the following order and their cincentrations
#[H20, 


import rhinoscriptsyntax as rs




def calculateVolume(x_, y_):
    v1 = x_*y_
    return v1

a = calculateVolume(x, y)
# ---------- end python ----------
move = Move(Geometry=box, Motion=vec_2.Vector)  # -> Geometry, Transform
panel = Panel(python.a)

# ----
pt = Point(<point referenced from the Rhino model>)
pt_2 = Point(<point referenced from the Rhino model>)
box_2 = DomainBox(Base=PlaneXY(0, 0, 0), X=Slider(50, range=0..100), Y=number_slider_2, Z=number_slider_2)
vec_3 = VectorXYZ(XComponent=number_slider, YComponent=number_slider, ZComponent=number_slider)  # -> Vector, Length
python_2 = GhPythonScript(startPoint=pt, size=number_slider)  # -> out, a
# ---------- python_2: Python ----------
__author__ = "linas"
__version__ = "2021.07.25"

import rhinoscriptsyntax as rs
from Rhino.Geometry import Point3d
import random

def boxMaker(firstPoint, recursion):
    
    a.append(firstPoint)
    
    moveX = random.uniform(0, size)
    moveY = random.uniform(0, size)
    
    
    if recursion < 10:
        movedPoint1 = firstPoint + Point3d(moveX, moveY,size)
        boxMaker(movedPoint1, recursion + 1)
        
        #movedPoint2 = firstPoint + Point3d(0,size,size)
        #boxMaker(movedPoint2, recursion + 1)



firstPoint = rs.coerce3dpoint(startPoint)

a = []
boxMaker (firstPoint, 0)
# ---------- end python_2 ----------
python_3 = GhPythonScript(x=pt_2, y=pt)  # -> out, a
# ---------- python_3: Python ----------
__author__ = "linas"
__version__ = "2021.07.25"

import rhinoscriptsyntax as rs



pt1 = rs.coerce3dpoint(x);
pt2 = rs.coerce3dpoint(y);
line = rs.AddLine(pt1, pt2);
a = line
# ---------- end python_3 ----------
geo = Geometry(box_2)
panel_2 = Panel(python_3.a)
boxprop = BoxProperties(Box=geo)  # -> Center, Diagonal, Area, Volume, Degeneracy
panel_3 = Panel(boxprop.Diagonal)
move_2 = Move(Geometry=python_2.a, Motion=vec_3.Vector)  # -> Geometry, Transform
box_3 = Box2Pt(PointA=python_2.a, PointB=move_2.Geometry, Plane=PlaneXY(0, 0, 0))
python_4 = GhPythonScript(x=boxprop.Diagonal, y=boxprop.Volume)  # -> out, a
# ---------- python_4: Python ----------
__author__ = "linas"
__version__ = "2021.07.23"

import rhinoscriptsyntax as rs



a=3
def changingBox (num) :

    if a>1:
        print(type(num))
        num[1] = 150
    return(num)


changingBox(x)
# ---------- end python_4 ----------
boxprop_2 = BoxProperties(Box=move.Geometry)  # -> Center, Diagonal, Area, Volume, Degeneracy
panel_4 = Panel(python_4.out)
